# Grasshopper definition S5-graph-stripper-custom-2.gh (Grasshopper 1.0.8)
# plug-ins: Human, Weaverbird

number_slider = Slider(3, range=0..10)
graphs_05_stripper_custom = FilePath("C:\Users\mtzav\Desktop\MPDA\new python\MPDA25-Session05\graphs\graphs-05-stripper-custom.py")
make_sure_is_the_right_path = Panel(graphs_05_stripper_custom)
quadmesh = Mesh(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)
enneper = Data(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)
trimesh = Mesh(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)
mplane = MeshPlane(
    Boundary={Plane=PlaneXY(0, 0, 0), Size=Domain2(u=-10..10, v=-10..10)},
    WidthCount=number_slider,
    HeightCount=number_slider)  # -> Mesh, Area
input_mesh = Mesh(enneper)
file = ReadFile(File=graphs_05_stripper_custom, PerLineParse=False)
preview = CustomPreview(Geometry=input_mesh, Material=ColourSwatch(SwatchColor=RGBA(122, 122, 122, 50)))
demesh = DeconstructMesh(Mesh=input_mesh)  # -> Vertices, Faces, Colours, Normals
py3 = Python3Script(script=file, m=input_mesh, s=Slider(7, range=0..10))  # -> out, a, b, c; inputs m: Mesh, s: Int32; unedited script template
conmesh = ConstructMesh(Vertices=demesh.Vertices, Faces=graft(demesh.Faces))  # -> flatten(Mesh)
data = Data(py3.a)
item = ListItem(List=conmesh, Index=py3.a, Wrap=True)
number_slider_2 = Slider(52, range=0..100)
pline = PolyLine(Vertices=py3.b, Closed=False)  # -> flatten(Polyline)
clean = CombineClean(Meshes=item)  # -> flatten(Mesh)
lng = ListLength(List=clean)
series = Series(Start=0, Step=1, Count=lng)
lng_2 = ListLength(List=pline)
Z = UnitZ(Factor=series)
wheel = ColourWheel(
    lng_2,
    ColourGrips_Style=30,
    ColourGrips_Grip=[0, 2.094395102, 4.188790205, 3.141592654],
    ColourGrips_Lum=[0.1, 0.5],
    ColourGrips_Range=[0.2617993878, 0.2617993878, 0.2617993878, 0.2617993878],
    ColourGrips_Sat=[0.2, 0.6])
move = Move(Geometry=clean, Motion=Z)  # -> Geometry, Transform
item_2 = ListItem(List=clean, Index=number_slider_2, Wrap=True)
wbnaked = WeaverbirdsNakedBoundary(MeshClosedPolylines=clean)
item_3 = ListItem(List=pline, Index=number_slider_2, Wrap=True)
previewlw = CustomPreviewLineweights(Geometry=pline, Shader=wheel, Thickness=Slider(2, range=0..2), Absolute=False)
all_shorest_paths = Data(move.Geometry)
explode = Explode(Curve=wbnaked, Recursive=True)  # -> Segments, Vertices
shift = ShiftList(List=explode.Segments, Shift=1, Wrap=invert(True))
angle = Angle(VectorA=explode.Segments, VectorB=shift)  # -> Angle, Reflex
ma = MassAddition(Input=angle.Angle)  # -> Result, PartialResults
sort = SortList(Keys=ma.Result, ValuesA=graft(clean))  # -> Keys, ValuesA
best_shortest_path = Data()
