# Grasshopper definition S5-graph-stripper-custom-3.gh (Grasshopper 1.0.8)
# plug-ins: Human, Tree8

number_slider = Slider(3, range=0..10)
graphs_05_stripper_custom = FilePath("C:\Users\david\Desktop\MPDA25-Session05\graphs\graphs-05-stripper-custom.py")
make_sure_is_the_right_path = Panel(graphs_05_stripper_custom)
quadmesh = Mesh(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)
enneper = Data(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)
trimesh = Mesh(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)
mplane = MeshPlane(
    Boundary={Plane=PlaneXY(0, 0, 0), Size=Domain2(u=-10..10, v=-10..10)},
    WidthCount=number_slider,
    HeightCount=number_slider)  # -> Mesh, Area
input_mesh = Mesh(enneper)
file = ReadFile(File=graphs_05_stripper_custom, PerLineParse=False)
preview = CustomPreview(Geometry=input_mesh, Material=ColourSwatch(SwatchColor=RGBA(122, 122, 122, 50)))
demesh = DeconstructMesh(Mesh=input_mesh)  # -> Vertices, Faces, Colours, Normals
py3 = Python3Script(script=file, m=input_mesh, s=Slider(5, range=0..10))  # -> out, a, b, c; inputs m: Mesh, s: Int32; unedited script template
conmesh = ConstructMesh(Vertices=demesh.Vertices, Faces=graft(demesh.Faces))  # -> flatten(Mesh)
panel = Panel(py3.a)
item = ListItem(List=conmesh, Index=py3.a, Wrap=True)
number_slider_2 = Slider(52, range=0..100)
pline = PolyLine(Vertices=py3.b, Closed=False)  # -> flatten(Polyline)
clean = CombineClean(Meshes=item)  # -> flatten(Mesh)
lng = ListLength(List=clean)
series = Series(Start=0, Step=1, Count=lng)
lng_2 = ListLength(List=pline)
area = Area(Geometry=conmesh)  # -> Area, Centroid
Z = UnitZ(Factor=series)
wheel = ColourWheel(
    lng_2,
    ColourGrips_Style=30,
    ColourGrips_Grip=[0, 2.094395102, 4.188790205, 3.141592654],
    ColourGrips_Lum=[0.1, 0.5],
    ColourGrips_Range=[0.2617993878, 0.2617993878, 0.2617993878, 0.2617993878],
    ColourGrips_Sat=[0.2, 0.6])
move = Move(Geometry=clean, Motion=Z)  # -> Geometry, Transform
item_2 = ListItem(List=clean, Index=number_slider_2, Wrap=True)
all_shortest_paths = Data(py3.a)
meshfacepoints = Data(area.Centroid)
list_of_list_of_face_indexes = Panel(all_shortest_paths)
mesh = Data(input_mesh)
item_3 = ListItem(List=pline, Index=number_slider_2, Wrap=True)
all_shortest_paths_2 = Data(move.Geometry)
previewlw = CustomPreviewLineweights(Geometry=pline, Shader=wheel, Thickness=Slider(2, range=0..2), Absolute=False)
explode = Explode(Curve=pline, Recursive=True)  # -> Segments, Vertices
item_4 = ListItem(List=meshfacepoints, Index=all_shortest_paths, Wrap=True)
pline_2 = PolyLine(Vertices=item_4, Closed=False)

# ---- group: filter by length
explode_2 = Explode(Curve=pline_2, Recursive=True)  # -> Segments, Vertices
number_slider_3 = Slider(8, range=0..10)
lng_3 = ListLength(List=explode_2.Segments)
larger = LargerThan(FirstNumber=lng_3, SecondNumber=number_slider_3)  # -> LargerThan, OrEqualTo
smaller = SmallerThan(FirstNumber=lng_3, SecondNumber=number_slider_3)  # -> SmallerThan, OrEqualTo

# ----
viewer = ParamViewer(all_shortest_paths)

# ---- group: assignment template
py3_2 = Python3Script(all_shortest_paths=all_shortest_paths, mesh=mesh, MeshFacePoints=meshfacepoints)  # -> out, selected_shortest_path; inputs all_shortest_paths: tree, mesh: tree, MeshFacePoints: tree
# ---------- py3_2: Python ----------
import ghpythonlib.treehelpers as th # type: ignore

#convert all_shortest_paths tree to python list
all_shortest_path = th.tree_to_list(all_shortest_paths)







#this is the end result: one list of integers that represent face indexes
# a = selected_shorest_path
# ---------- end py3_2 ----------

# ----
# translate this to python code
best_shortest_path = Data([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])
seleted_shortest_path = Data(py3_2.selected_shortest_path)
cull = CullPattern(List=viewer, CullPattern=flatten(smaller.SmallerThan))
cull_2 = CullPattern(List=clean, CullPattern=flatten(smaller.SmallerThan))
cull_3 = CullPattern(List=flatten(pline_2), CullPattern=flatten(smaller.SmallerThan))

# ---- group: filter by straighness
explode_3 = Explode(Curve=cull_3, Recursive=True)  # -> Segments, Vertices
cull_i = CullIndex(List=explode_3.Segments, Indices="-1", Wrap=True)
shift = ShiftList(List=explode_3.Segments, Shift=1, Wrap=False)
angle = Angle(VectorA=cull_i, VectorB=shift)  # -> Angle, Reflex
avr = Average(Input=angle.Angle)  # -> flatten(ArithmeticMean)
nullrep = ReplaceNulls(Items=avr, Replacements="100")  # -> Items, Count

# ----
sort = SortList(Keys=flatten(nullrep.Items), ValuesA=flatten(cull_2), ValuesB=flatten(cull_3), ValuesC=flatten(cull))  # -> Keys, ValuesA, ValuesB, ValuesC
item_5 = ListItem(List=sort.ValuesA, Index=0, Wrap=True)
item_6 = ListItem(List=sort.ValuesB, Index=0, Wrap=True)
item_7 = ListItem(List=sort.ValuesC, Index=0, Wrap=True)
tbranch = TreeBranch(Tree=all_shortest_paths, Path=item_7, MaintainPaths=True, SplitTree=False)
seleted_shortest_path_2 = Data(tbranch)
panel_3 = Panel(seleted_shortest_path_2)
