# Grasshopper definition S5-graph-stripper-custom.gh (Grasshopper 1.0.8)

number_slider = Slider(3, range=0..10)
graphs_05_stripper_custom = FilePath("C:\Users\david\Desktop\MPDA\repos\MPDA25-Session05\graphs\graphs-05-stripper-custom.py")
make_sure_is_the_right_path = Panel(graphs_05_stripper_custom)
quadmesh = Mesh(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)
enneper = Data(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)
trimesh = Mesh(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)
mplane = MeshPlane(
    Boundary={Plane=PlaneXY(0, 0, 0), Size=Domain2(u=-10..10, v=-10..10)},
    WidthCount=number_slider,
    HeightCount=number_slider)  # -> Mesh, Area
input_mesh = Mesh(enneper)
file = ReadFile(File=graphs_05_stripper_custom, PerLineParse=False)
py3 = Python3Script(script=file, m=input_mesh, s=Slider(2, range=0..10))  # -> out, a, b, c; inputs m: Mesh, s: Int32; unedited script template
pline = PolyLine(Vertices=py3.b, Closed=False)  # -> flatten(Polyline)
