# Grasshopper definition S5-graph-stripper.gh (Grasshopper 1.0.8)

number_slider = Slider(3, range=0..10)
graphs_06_stripper_py = FilePath("C:\Users\david\Desktop\MPDA\repos\MPDA25-Session04\graphs\graphs-06-stripper.py")
make_sure_is_the_right_path = Panel(graphs_06_stripper_py)
quadmesh = Mesh(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)
trimesh = Mesh(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)
mplane = MeshPlane(
    Boundary={Plane=PlaneXY(0, 0, 0), Size=Domain2(u=-10..10, v=-10..10)},
    WidthCount=number_slider,
    HeightCount=number_slider)  # -> Mesh, Area
input_mesh = Mesh(trimesh)
preview = CustomPreview(
    Geometry=input_mesh,
    Material={diffuse=RGB(221, 160, 221), emission=RGB(66, 48, 66), shine=0.5, specular=RGB(255, 255, 255), transparency=0})
file = ReadFile(File=graphs_06_stripper_py, PerLineParse=False)
demesh = DeconstructMesh(Mesh=input_mesh)  # -> Vertices, Faces, Colours, Normals
conmesh = ConstructMesh(Vertices=demesh.Vertices, Faces=graft(demesh.Faces), Colours=demesh.Colours)  # -> flatten(Mesh)
py3 = Python3Script(script=file, m=input_mesh)  # -> out, a, b, c, d; inputs m: Mesh; unedited script template
partition = PartitionList(List=py3.b, Size=py3.c)
partition_2 = PartitionList(List=py3.a, Size=py3.c)
points = PointList(Points=py3.a)
item = ListItem(List=conmesh, Index=partition, Wrap=True)
pline = PolyLine(Vertices=partition_2, Closed=False)
tstat = TreeStatistics(Tree=item)  # -> Paths, Length, Count
series = Series(Start="1", Step=1, Count=tstat.Count)
gradient = Gradient(
    LowerLimit="1",
    UpperLimit=tstat.Count,
    Parameter=series,
    stops=[0: RGB(243, 57, 0), 0.1: RGB(236, 27, 60), 0.2: RGB(210, 0, 118), 0.3: RGB(103, 0, 120), 0.4: RGB(39, 72, 161), 0.5: RGB(1, 192, 229), 0.6: RGB(18, 178, 90), 0.7: RGB(79, 186, 8), 0.8: RGB(220, 237, 32), 0.9: RGB(247, 159, 20), 1: RGB(243, 57, 0)])
preview_2 = CustomPreview(Geometry=pline, Material=graft(ColourSwatch(SwatchColor=RGBA(0, 0, 0, 99))))
preview_3 = CustomPreview(Geometry=item, Material=graft(gradient))
