# Grasshopper definition S5-graph-walker-custom.gh (Grasshopper 1.0.8)

number_slider = Slider(3, range=0..10)
graphs_06_walker_custom_py = FilePath("C:\Users\david\Desktop\MPDA\repos\MPDA25-Session05\graphs\graphs-06-walker-custom.py")
make_sure_is_the_right_path = Panel(graphs_06_walker_custom_py)
eneper = Data(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)
quadmesh = Mesh(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)
trimesh = Mesh(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)
mplane = MeshPlane(
    Boundary={Plane=PlaneXY(0, 0, 0), Size=Domain2(u=-10..10, v=-10..10)},
    WidthCount=number_slider,
    HeightCount=number_slider)  # -> Mesh, Area
input_mesh = Mesh(eneper)
file = ReadFile(File=graphs_06_walker_custom_py, PerLineParse=False)
py3 = Python3Script(script=file, m=input_mesh, s=Slider(3, range=0..10))  # -> out, a, b, c, d; inputs m: Mesh, s: Int32; unedited script template
panel = Panel(py3.out)
data = Data(py3.b)
all_shortest_paths = Data(py3.c)
demesh = DeconstructMesh()  # -> Vertices, Faces, Colours, Normals
conmesh = ConstructMesh(Vertices=demesh.Vertices, Faces=graft(demesh.Faces), Colours=demesh.Colours)

# ---- group: custom logic
lng = ListLength(List=all_shortest_paths)
tstat = TreeStatistics(Tree=all_shortest_paths)  # -> Paths, Length, Count
sort = SortList(Keys=flatten(lng), ValuesA=tstat.Paths)  # -> reverse(Keys), reverse(ValuesA)
item = ListItem(List=sort.ValuesA, Index=0, Wrap=True)
branch = TreeBranch(Tree=all_shortest_paths, Path=item, MaintainPaths=True)

# ----
item_2 = ListItem(List=flatten(conmesh), Index=all_shortest_paths, Wrap=True)
clean = CombineClean(Meshes=item_2)
unroller = Unroller(Strip=clean, Unroll=Slider(1, range=0..1))
item_3 = ListItem(List=flatten(unroller), Index=Slider(420, range=0..1000), Wrap=True)
demesh_2 = DeconstructMesh()  # -> Vertices, Faces, Colours, Normals
demesh_3 = DeconstructMesh()  # -> Vertices, Faces, Colours, Normals
# a sequence of indexes of faces
chosen_path = Data(branch)
panel_2 = Panel(chosen_path)
conmesh_2 = ConstructMesh(Vertices=demesh_3.Vertices, Faces=graft(demesh_3.Faces))  # -> flatten(Mesh)
cull_i = CullIndex(List=demesh_2.Faces, Indices=chosen_path, Wrap=True)
conmesh_3 = ConstructMesh(Vertices=demesh_2.Vertices, Faces=graft(cull_i))  # -> flatten(Mesh)
item_4 = ListItem(List=conmesh_2, Index=chosen_path, Wrap=True)
clean_2 = CombineClean(Meshes=conmesh_3)
clean_3 = CombineClean(Meshes=item_4)
py3_2 = Python3Script(m=clean_2)  # -> out, a; inputs m: Mesh
# ---------- py3_2: Python ----------
import scriptcontext as sc


sc.sticky["mesh"] = m
# ---------- end py3_2 ----------
preview = CustomPreview(Geometry=clean_2, Material=ColourSwatch(SwatchColor=RGBA(156, 156, 156, 109)))
rec = DataRecorder(clean_3, DataLimit=-10, RecordData=True)
Z = UnitZ(Factor=Slider(51, range=0..100))
move = Move(Geometry=rec, Motion=Z)  # -> Geometry, Transform
