# Grasshopper definition S5-graph-walker.gh (Grasshopper 1.0.8)

number_slider = Slider(3, range=0..10)
graphs_05_shorest_paths = FilePath("C:\Users\david\Desktop\MPDA\repos\MPDA25-Session05\graphs\graphs-05-walker.py")
make_sure_is_the_right_path = Panel(graphs_05_shorest_paths)
quadmesh = Mesh(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)
trimesh = Mesh(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)
mplane = MeshPlane(
    Boundary={Plane=PlaneXY(0, 0, 0), Size=Domain2(u=-10..10, v=-10..10)},
    WidthCount=number_slider,
    HeightCount=number_slider)  # -> Mesh, Area
input_mesh = Mesh(trimesh)
file = ReadFile(File=graphs_05_shorest_paths, PerLineParse=False)
demesh = DeconstructMesh(Mesh=input_mesh)  # -> Vertices, Faces, Colours, Normals
preview = CustomPreview(
    Geometry=input_mesh,
    Material={diffuse=RGB(221, 160, 221), emission=RGB(66, 48, 66), shine=0.5, specular=RGB(255, 255, 255), transparency=0})
conmesh = ConstructMesh(Vertices=demesh.Vertices, Faces=graft(demesh.Faces))  # -> flatten(Mesh)
py3 = Python3Script(script=file, m=input_mesh, s=Slider(0, range=0..10), t=Slider(67, range=0..100))  # -> out, a, b, c; inputs m: Mesh, s: Int32, t: Int32; unedited script template
points = PointList(Points=py3.a)
item = ListItem(List=conmesh, Index=py3.c, Wrap=True)
area = Area(Geometry=item)  # -> Area, Centroid
pline = PolyLine(Vertices=area.Centroid, Closed=False)
unroller = Unroller(Strip=item, Unroll=1)
